% Simulink data dictionary SharedData.sldd

speedCommandMin = Simulink.Parameter(0)
speedCommandMax = Simulink.Parameter(100)
controllerKd = Simulink.Parameter(0)
controllerFilterCoeff = Simulink.Parameter(0)
controllerKp = Simulink.Parameter(0.5)
controllerKi = Simulink.Parameter(10)
Run_on_Hardware_Configuration = Simulink.ConfigSet(StartTime="0", StopTime="inf", Solver="ode3", ProdHWDeviceType="Atmel->AVR", SystemTargetFile="ert.tlc", HardwareBoard="Arduino Uno", TargetLang="C")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
arduinoVolts = Simulink.Parameter(5, Unit="V")  % Voltage of arduino (for mapping voltage/current measurements)
analogReadMax = Simulink.Parameter(1023)  % Max value of Arduino Analog Input block
analogReadMin = Simulink.Parameter(0)  % Min value of Arduino Analog Input block
arduinoBattVoltagePin = Simulink.Parameter(5)  % Pin for measuring pack voltage
arduinoCurrentPin = Simulink.Parameter(4)  % Pin for measuring total current draw
arduinoPWMPin = Simulink.Parameter(5)  % Pin for sending commands to ESC
arduinoRPMPin = Simulink.Parameter(2)  % Pin for measuring motor RPM
arduinoSampleTime = Simulink.Parameter(0.1, Unit="s")  % Sample time for Arduino input blocks
batteryCurrentMax = Simulink.Parameter(120, Unit="A")  % Max allowable current draw - For ESTOP
batteryCurrentSensorSensitivity = Simulink.Parameter(0.02, Unit="mV/A")  % Sensitivity factor for current sensor
batteryVoltageMax = Simulink.Parameter(26, Unit="V")  % Max battery voltage - for dashboard
batteryVoltageMin = Simulink.Parameter(21, Unit="V")  % Min allowable battery voltage - for ESTOP
batteryVoltReductionFactor = Simulink.Parameter(11)  % Measured voltage to pack voltage conversion-- based on resistance of voltage divider circuit
motorPulsePerRot = Simulink.Parameter(4)  % For tachometer measurment-- number of pulses per motor revolution
motorRPMMax = Simulink.Parameter(32000, Unit="rpm")  % Max allowable motor RPM - for ESTOP and control scaling

stepsBeforeEstop = Simulink.Parameter(4)  % Number of time-steps the safety flag must be off-nominal before triggering an ESTOP
  % This is to prevent over-sensitivity and transient spikes from locking out user control

estopMotorSpeed = Simulink.Parameter(0)  % Speed command to send to motor during ESTOP
escCalibrateTime = Simulink.Parameter(2, Unit="s")  % Amount of time the ESC calibration scenario takes to run-- will lock out user commands until then
escCalibrate = Simulink.Parameter(Simulink.data.Expression(ExpressionString="true"), DataType="boolean")